# Grasshopper definition 003.gh (Grasshopper 0.9.76)

pt = Point([Point(1.988029754, 2.393847361, 0), Point(2.526272279, 1.240470521, 0), Point(1.911137965, 5.238843568, 0), Point(2.910731226, 7.39181367, 0), Point(0.9884364924, 7.238030091, 0), Point(5.601943854, 8.314515142, 0), Point(11.59950342, 7.930056195, 0), Point(16.8281451, 7.084246512, 0), Point(18.44287268, 4.93127641, 0), Point(16.90503689, 1.548037679, 0), Point(17.59706299, 3.470332412, 0), Point(15.3672011, 6.315328619, 0), Point(13.06044742, 5.930869672, 0), Point(8.754507217, 7.31492188, 0), Point(3.218298384, 4.008574938, 0), Point(6.293969958, 1.548037679, 0), Point(11.36882806, 2.701414519, 0), Point(12.75288026, 4.623709253, 0), Point(7.524238588, 5.085059989, 0), Point(4.140999856, 6.469112197, 0)])
rec = Rectangle({Plane=PlaneXY(0, 0, 0), Size=Domain2(u=0..20, v=0..10)})
voronoi = Voronoi(Points=pt, Boundary=rec, BruteForceOverride=False)
crv = Curve(voronoi)
